vi "index.gviweb"   [G Web Development Software 22.3.0]
panel controls:
  "Exit (development only)": bool
  "Test Start": bool
  "Test Sequence": T3[]
  "Cancel": bool
panel indicators:
  "Total Duration (s)": f64
  "Step Status": T1[]
  "manager": error
  "ui": error
  "Program Log": string
  "dev status": string
  "Status": string
  "Initialized": bool
  "Finalized": bool
  "io": error
  "Graph": f64[][]
  "Pass": bool
types:
  "Color.gtype" = u32
  T1 = cluster{"Progress": f64, "Result": "Color.gtype"}
  T2 = cluster{"Waveform": enum{"Constant", "Sawtooth", "Sinusoid"}, "Amplitude": f64, "Frequency": f64}
  T3 = cluster{"Duration (s)": f64, "Waveform Data": T2, "Fault Probability": f64}
  "Manager State.gtype" = enum{"Idle", "Initialize", "Execute", "Finalize", "Cancel", "Error"}
  "Message Queue Names.gtype" = enum{"Manager", "UI", "IO"}
  "Step Data.gtype" = cluster{"Message Queue": "Message Queue Names.gtype", "Action": string}
  "Sequence.gtype" = cluster{"Manager State": "Manager State.gtype", "Steps": "Step Data.gtype"[]}
  "Manager Data.gtype" = cluster{"Current State": "Manager State.gtype", "Current Step": "Step Data.gtype", "Remaining Steps": "Step Data.gtype"[], "Remaining Sequences": "Sequence.gtype"[], "Current Instruction": string}
  "Step Result.gtype" = enum{"Pass", "Fail", "Canceled"}
  "Step Status.gtype" = cluster{"Progress": f64, "Result": "Step Result.gtype", "Complete": bool}
  "Waveforms.gtype" = enum{"Constant", "Sawtooth", "Sinusoid"}
  "Waveform Data.gtype" = cluster{"Waveform": "Waveforms.gtype", "Amplitude": f64, "Frequency": f64}
  "Test Step Data.gtype" = cluster{"Duration (s)": f64, "Waveform Data": "Waveform Data.gtype", "Fault Probability": f64}
  "IO Data.gtype" = cluster{"Waveform": "Waveforms.gtype", "Duration (s)": f64, "Start Time": timestamp, "Time Factor": f64, "Adjusted Amplitude": f64, "New Wave": bool, "Wave Active": bool, "Fault start time": f64}
uses:
  WebApp::support::Message Queue::Create All Message Queues.gvi
  WebApp::support::Message Queue::Dequeue Message.gvi
  WebApp::support::Message Queue::Enqueue Message (Single).gvi
  NI::G Core::Error::Build Error Cluster.gvi
  WebApp::UI messages::Append Log Text.gviweb
  WebApp::program sequences::Handle Next Sequence.gviweb
  WebApp::program sequences::Handle Next Step.gviweb
  WebApp::UI messages::Send Sequence Complete UI Updates.gviweb
  WebApp::UI messages::Update Program Status.gviweb
  WebApp::support::Error Handler - Message Handling Loop.gvi
  WebApp::support::Error Handler - Event Handling Loop.gvi
  WebApp::Prep Step Staus for Display.gviweb
  WebApp::Calculate Test Duration.gviweb
  WebApp::Validate Test Sequence.gviweb
  WebApp::Report Step Complete.gviweb
  WebApp::Handle Data Remaining in Queue.gviweb
  WebApp::Get Result Color.gviweb
  WebApp::Receive IO Data.gviweb
  WebApp::globals.gviweb
  WebApp::IO::Handle Next Waveform.gviweb
  WebApp::IO::Generate Waveform.gviweb
  WebApp::IO::Handle Hardware IO.gviweb
  WebApp::debug::Check Test Sequence Complete.gviweb
diagram:
  # #debug
  Property Node(instance in=reference to "dev status", "Value"="") -> (error out=w1)
  w2 = bool FALSE  # Stop Event
  Create User Event[EventName="Stop Event"](error in=w1, user event data type=w2) -> (error out=w3, user event out=w4)
  # Make list of messages for easy screening
  w5 = [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]  # Instructions
  for {
    w6 = each element of w5
    Property Node(instance in=w6) -> ("Init Info:Instruction"=w8)
    append w8 to w7
  }
  # Idle
  #
  # Start Pressed
  #
  # Initializaing
  # 	>> To IO ---Initialize
  # 	Waiting on UI
  # 	>> To UI ---Initialize
  # 	Waiting on IO
  # Executing
  # 	>> To IO ---Execute
  # 	Waiting on IO
  # Finalizing
  # 	>> To IO ---Finalize
  # 	Waiting on IO
  # 	>> To UI ---Finalize
  # 	Waiting on UI
  # Completed
  Build Array("Manager", "UI", "IO") -> w9
  Array Size(array=w9) -> (size(s)=w10)
  call "Create All Message Queues.gvi"(Loop Count=w10, error in=w3) -> (Message Queues=w11, error out=w12)
  Array Index(array=w11) -> (out0[_]=w13, out1[_]=w14, out2[_]=w15)
  s1 = uninitialised  # shift register
  while {
    call "Dequeue Message.gvi"(message queue in=w13, error in=w12) -> (message queue out=w16, message=w17, message data=w18, error out=w19)
    # Manager Loop
    # w4: Stop Event
    case (w17) ignore case {  # Message Cases
      frame "SW Init" {
        w20 = w19
        w21 = default
        w22 = "Manager Data.gtype" {all zero or empty}
      }
      frame "Test Sequence Change" {
        Array Index(array=w11) -> (out0["UI"]=w23)
        call "Enqueue Message (Single).gvi"(message queue in=w23, message="Handle Test Change", message data=w18, error in=w19) -> (error out=w20)
        w21 = default
        w22 = s1
      }
      frame "Error" {
        # #CodeRecommended - Consider creating a system for logging errors in some way. These errors are for notification purposes only. Handling of specific errors should be performed in the message frames that generated the error.
        Variant To Data(error in (no error)=w19, type=no error, variant=w18) -> (data=w24, error out=w20)
        # #CodeRecommended - If you ever change the name of this "Error" message, you'll need to update the name in the Check Loop Error.vi as well.
        $manager <- w24
        w21 = default
        w22 = s1
      }
      frame "Exit Pressed" {
        # #development
        s2 = w19  # shift register
        for {
          w25 = each element of w11
          call "Enqueue Message (Single).gvi"(message queue in=w25, message="Exit", error in=s2) -> (error out=w26)
          next s2 = w26
        }
        Merge Errors(s2) -> (error out=w20)
        w21 = default
        w22 = s1
      }
      frame "Exit" {
        Generate User Event(event data=TRUE, user event=w4) -> (error out=w27)
        Release Queue(queue=w16) -> (error out=w28)
        Merge Errors(w28, w27) -> (error out=w20)
        w21 = TRUE
        w22 = s1
      }
      frame Default {
        w29 = "The invalid message string \"%s\" was received in the Message Handling Loop."
        # Message undefined
        Format Into String(formatString=w29, w17) -> w30
        call "Build Error Cluster.gvi"(code=1, description=w30, error in=w19) -> (error out=w20)
        w21 = default
        w22 = s1
      }
      frame "Instruction" {
        Variant To Data(error in (no error)=w19, type=w17, variant=w18) -> (data=w31, error out=w32)
        Search 1D Array(1D array=w7, element=w31) -> (index of element=w33)
        case (w33) {
          frame Default {
            # Message in sequence start list -> ensure in valid start state
            Property Node(instance in=s1) -> ("Current State"=w34, instance out=w35)
            Array Index(array=w5) -> (out0[w33]=w36)
            Property Node(instance in=w36) -> ("Init Info:Valid Starts"=w37, instance out=w38)
            Search 1D Array(1D array=w37, element=w34) -> (index of element=w39)
            case (w39) {
              frame Default {
                Format Into String(formatString="******************\nStart: %s\n******************", errIn=w32, w31) -> (outString=w40, errOut=w41)
                call "Append Log Text.gviweb"(Input=w11, resulting string=w40, error out=w41) -> (Output_2=w42)
                Property Node(instance in=w38) -> ("Sequences"=w43)
                # In valid state for recieved message -> react
                call "Handle Next Sequence.gviweb"(manager data in=w35, Sequences=w43, error in=w42, Message Queues=w11) -> (manager data out=w44, Sequence Steps=w45, End Instruction=w46, error out=w47)
                case (w46) {
                  frame True {
                    w48 = "-------------------------------------\nInstruction Sequences Empty\n-------------------------------------"
                    # #verify
                    call "Append Log Text.gviweb"(Input=w11, resulting string=w48, error out=w47) -> (Output_2=w20)
                    w22 = w44
                  }
                  frame False {
                    Property Node(instance in=w44, "Current Instruction"=w31) -> (instance out=w49)
                    call "Handle Next Step.gviweb"(message queues=w11, manager data in=w49, Sequence Steps=w45, Input=w47) -> (manager data out=w22, Output=w20)
                  }
                }
              }
              frame -1 {
                w50 = """-------------------------------------
Received inavalid message for current status

Invalid Message: %s

State: %s
Currently waiting on: %s
-------------------------------------"""
                Property Node(instance in=w35) -> ("Current State"=w51, "Current Step:Message Queue"=w52)
                Format Into String(formatString=w50, errIn=w32, w31, w51, w52) -> (outString=w53, errOut=w54)
                call "Append Log Text.gviweb"(Input=w11, resulting string=w53, error out=w54) -> (Output_2=w20)
                w22 = w35
              }
            }
          }
          frame -1 {
            # Instruction name missing from list
            # Message undefined
            Format Into String(formatString="Instruction \"%s\" undefined.", w17) -> w55
            call "Build Error Cluster.gvi"(code=1, description=w55, error in=w32) -> (error out=w20)
            w22 = s1
          }
        }
        w21 = default
      }
      frame "Step Complete" {
        Property Node(instance in=s1) -> ("Current Step"=w56)
        Variant To Data(error in (no error)=w19, type=w56, variant=w18) -> (data=w57, error out=w58)
        Is Equal[ComparisonMode=CompareAggregates](x=w56, y=w57) -> w59
        case (w59) {
          frame False, Default {
            w20 = w58
            w22 = s1
          }
          frame True {
            Property Node(instance in=s1) -> ("Remaining Steps"=w60, instance out=w61)
            Array Size(array=w60) -> (size(s)=w62)
            Property Node(instance in=w56) -> ("Message Queue"=w63, "Action"=w64)
            Format Into String(formatString="Completed %s %s", errIn=w58, w63, w64) -> (outString=w65, errOut=w66)
            call "Append Log Text.gviweb"(Input=w11, resulting string=w65, error out=w66) -> (Output_2=w67)
            case (w62) {
              frame Default {
                call "Handle Next Step.gviweb"(message queues=w11, manager data in=w61, Sequence Steps=w60, Input=w67) -> (manager data out=w22, Output=w20)
              }
              frame 0 {
                Property Node(instance in=w61) -> ("Remaining Sequences"=w68, "Current State"=w69, instance out=w70)
                call "Send Sequence Complete UI Updates.gviweb"(Current State=w69, Input=w11, Error In=w67) -> (Error out=w71)
                call "Handle Next Sequence.gviweb"(manager data in=w70, Sequences=w68, error in=w71, Message Queues=w11) -> (manager data out=w72, Sequence Steps=w73, End Instruction=w74, error out=w75)
                Property Node(instance in=w72) -> ("Current State"=w76, instance out=w77)
                Format Into String(formatString="%s", errIn=w75, w76) -> (outString=w78, errOut=w79)
                case (w74) {
                  frame False, Default {
                    call "Update Program Status.gviweb"(resulting string=w78, Message Queues=w11) -> (error out=w80)
                    call "Handle Next Step.gviweb"(message queues=w11, manager data in=w77, Sequence Steps=w73, Input=w80) -> (manager data out=w22, Output=w20)
                  }
                  frame True {
                    call "Update Program Status.gviweb"(resulting string=w78, Message Queues=w11, Input=w79) -> (error out=w81)
                    # Instruction complete
                    Property Node(instance in=w77) -> ("Current Instruction"=w82, instance out=w22)
                    Format Into String(formatString="******************\nComplete: %s\n******************", w82) -> w83
                    call "Append Log Text.gviweb"(Input=w11, resulting string=w83, error out=w81) -> (Output_2=w20)
                  }
                }
              }
            }
          }
        }
        w21 = default
      }
    }
    call "Error Handler - Message Handling Loop.gvi"(message queue in=w16, error in=w20) -> (dup error in=w84)
    next s1 = w22
    stop if w21
  }
  # #todo
  # create separate program instruction case
  # error handling - display in status log
  # create/ configure simulation cases/ flags
  # clean up
  # 	save all text log messages in same place
  # handle error from hardware during initialize or execute
  # 	be able to clear error
  #
  #
  #
  # #additional functionality
  # ---------------------------------
  # add finalize commands
  # 	log data
  # 		with test meta data/ description
  # 	log results
  # cancel
  # abort
  # hardware fault button
  # 	just poll in UI loop?
  # -------------------------------------------------------
  # cancel
  # abort
  # Display test history/ data
  # Pause
  # select between historical data
  # historical analysis/ comparison
  # Splining/ smooth transitions between waveforms
  # unit tests
  # check for empty test sequence
  # force sawtooth to return to 0 before waveform transition?
  # unit tests
  Register For Events("Stop Event"=w4) -> (event registration refnum out=w85)
  # cancel
  #
  # show canceled status
  # show cancel LED lights
  # 	use step completed data
  # add info to messages:
  # ******************
  # Start: Test Start
  # ******************
  # ******************
  # Start: Cancel
  # ******************
  #
  # error fault sim
  # be able to clear error with corresponding case in IO
  s3 = w85  # shift register
  while {
    event (dynamic events = s3) {
      on "Test Start" Value changed {
        # #CodeNeeded - Send the appropriate message for this user interface event.
        call "Enqueue Message (Single).gvi"(message queue in=w13, message="Instruction", message data="Run Test Sequence") -> (message queue out=w88, error out=w87)
        w86 = default
      }
      on "Cancel" Value changed {
        # #CodeNeeded - Send the appropriate message for this user interface event.
        call "Enqueue Message (Single).gvi"(message queue in=w13, message="Instruction", message data="Cancel") -> (message queue out=w88, error out=w87)
        w86 = default
      }
      on "Exit (development only)" Value changed {
        call "Enqueue Message (Single).gvi"(priority message=TRUE, message queue in=w13, message="Exit Pressed") -> (message queue out=w88, error out=w87)
        w86 = default
      }
      on dynamic event 0 {
        # The Message Handling Loop processed an "Exit" message, which fired this event to stop the Event Handling Loop.
        w86 = TRUE
        w87 = default
        w88 = w13
      }
      on "Test Sequence" Value changed {
        Event Data() -> ("New Value"=w89)
        To Variant(anything=w89) -> w90
        call "Enqueue Message (Single).gvi"(message queue in=w13, message="Test Sequence Change", message data=w90) -> (message queue out=w88, error out=w87)
        w86 = default
      }
    }
    call "Error Handler - Event Handling Loop.gvi"(message queue in=w88, error in=w87) -> (dup error in=w91)
    stop if w86
  }
  Unregister For Events(error in=w91, event registration refnum=s3) -> (error out=w92)
  Merge Errors(w92, w84) -> (error out=w93)
  Destroy User Event(error in=w93, user event=w4)
  Obtain Queue(element data type=f64[] [], name="output data") -> (queue out=w94)
  s4 = uninitialised  # shift register
  s5 = uninitialised  # shift register
  s6 = uninitialised  # shift register
  s7 = uninitialised  # shift register
  s8 = uninitialised  # shift register
  s9 = uninitialised  # shift register
  while {
    call "Dequeue Message.gvi"(message queue in=w14, timeout in milliseconds=s5, error in=w12) -> (timed out?=w95, message queue out=w96, message=w97, message data=w98, error out=w99)
    # UI Update Loop
    # s9: Step Index
    # s8: Test Steps
    # s5: Dequeue Timeout
    case (w97) ignore case {  # Message Cases
      frame "SW Init" {
        Property Node(instance in=reference to "Pass", "Value"=FALSE)
        Property Node(instance in=reference to "Finalized", "Value"=FALSE)
        Property Node(instance in=reference to "Test Sequence", "Disabled"=FALSE)
        Property Node(instance in=reference to "ui", "Value"=no error, error in=w99) -> (error out=w108, instance out=w109)
        Property Node(instance in=reference to "Initialized", "Value"=FALSE, error in=w99) -> (error out=w110, instance out=w111)
        Property Node(instance in=reference to "Status", "Value"="Idle", error in=w99) -> (error out=w112, instance out=w113)
        Property Node(instance in=reference to "Program Log", "Value"="", error in=w99) -> (error out=w114, instance out=w115)
        Build Array(w109, w111, w113, w115) -> w116
        Merge Errors(w108, w110, w112, w114) -> (error out=w117)
        s10 = w117  # shift register
        for {
          w118 = each element of w116
          Close Reference(error in=s10, reference=w118) -> (error out=w119)
          next s10 = w119
        }
        Array Size(array=[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]) -> (size(s)=w106)
        Initialize Array(element="Step Status.gtype" {all zero or empty}, size=w106) -> w105
        call "Prep Step Staus for Display.gviweb"(Steps status out=w105) -> (Step Status=w120)
        Property Node(instance in=reference to "Step Status", "Value"=w120)
        call "Calculate Test Duration.gviweb"(Test Sequences=[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]) -> (Total Duration (s)=w121)
        Property Node(instance in=reference to "Total Duration (s)", "Value"=w121)
        w100 = s10
        w101 = default
        w102 = ""
        w103 = -1
        w104 = f64[][] []
        w107 = 0
      }
      frame "Handle Test Change" {
        Variant To Data(error in (no error)=w99, type="Test Step Data.gtype"[] [], variant=w98) -> (data=w122, error out=w123)
        Array Size(array=w122) -> (size(s)=w106)
        call "Calculate Test Duration.gviweb"(Test Sequences=w122) -> (Total Duration (s)=w124)
        $"Total Duration (s)" <- w124
        call "Validate Test Sequence.gviweb"(Input=reference to "Test Sequence", UI Queue=w96, data=w122, error in=w123) -> (Error out=w100)
        w101 = default
        w102 = s4
        w103 = s5
        w104 = s6
        w105 = s7
        w107 = s9
      }
      frame "Execute" {
        # start polling to process data from IO loop
        call "Report Step Complete.gviweb"(Manager Queue=w13, This Queue Name="UI", Step Name=w97, Input_3=w99) -> (Output_2=w100)
        w101 = default
        w102 = s4
        w103 = 0
        w104 = s6
        w105 = s7
        w106 = s8
        w107 = s9
      }
      frame "Update Status" {
        Variant To Data(error in (no error)=w99, type=string "", variant=w98) -> (data=w125, error out=w100)
        Format Into String(formatString="%s\n%s", s4, w125) -> w102
        $"Program Log" <- w102
        w101 = default
        w103 = s5
        w104 = s6
        w105 = s7
        w106 = s8
        w107 = s9
      }
      frame "Update Program Status" {
        Variant To Data(error in (no error)=w99, type=w97, variant=w98) -> (data=w126, error out=w100)
        $Status <- w126
        w101 = default
        w102 = s4
        w103 = s5
        w104 = s6
        w105 = s7
        w106 = s8
        w107 = s9
      }
      frame "Initialize Complete" {
        $Initialized <- TRUE
        w100 = w99
        w101 = default
        w102 = s4
        w103 = s5
        w104 = s6
        w105 = s7
        w106 = s8
        w107 = s9
      }
      frame "Initialize" {
        Property Node(instance in=reference to "Test Sequence", "Disabled"=TRUE)
        # Enure at least 1 step is present
        Max And Min(x=s8, y=1) -> (max(x,y)=w127: i32)
        Initialize Array(element="Step Status.gtype" {all zero or empty}, size=w127) -> w105
        call "Prep Step Staus for Display.gviweb"(Steps status out=w105) -> (Step Status=w128)
        Property Node(instance in=reference to "Step Status", "Value"=w128, error in=w99) -> (error out=w129)
        call "Report Step Complete.gviweb"(Manager Queue=w13, This Queue Name="UI", Step Name=w97, Input_3=w129) -> (Output_2=w100)
        w101 = default
        w102 = s4
        w103 = s5
        w104 = f64[][] []
        w106 = s8
        w107 = 0
      }
      frame "Execute Complete" {
        # Handle any data remaining in queue
        call "Handle Data Remaining in Queue.gviweb"(Input_3=reference to "Graph", Input_2=reference to "Step Status", Input_4=w94, Input_5=s9, Input=s6, Input_6=s7, Input_7=w99) -> (Output=w107, Output_3=w104, Output_4=w105, Output_2=w100)
        w101 = default
        w102 = s4
        w103 = s5
        w106 = s8
      }
      frame "Finalize" {
        s11 = "Pass"  # shift register
        for {
          w130 = each element of s7
          Property Node(instance in=w130) -> ("Result"=w131)
          case (s11) {
            frame "Pass", Default {
              w132 = w131
            }
            frame "Fail" {
              case (w131) {
                frame Default {
                  w132 = w131
                }
                frame "Pass" {
                  w132 = s11
                }
              }
            }
            frame "Canceled" {
              w132 = "Canceled"
            }
          }
          next s11 = w132
        }
        call "Get Result Color.gviweb"(Input=s11) -> (Output=w133)
        Property Node(instance in=reference to "Pass", "TrueColor"=w133)
        # stop polling
        $Pass <- TRUE
        Property Node(instance in=reference to "Test Sequence", "Disabled"=TRUE)
        call "Report Step Complete.gviweb"(Manager Queue=w13, This Queue Name="UI", Step Name=w97, Input_3=w99) -> (Output_2=w100)
        w101 = default
        w102 = s4
        w103 = -1
        w104 = s6
        w105 = s7
        w106 = s8
        w107 = s9
      }
      frame "Finalize Complete" {
        $Finalized <- TRUE
        Property Node(instance in=reference to "Test Sequence", "Disabled"=FALSE)
        w100 = w99
        w101 = default
        w102 = s4
        w103 = s5
        w104 = s6
        w105 = s7
        w106 = s8
        w107 = s9
      }
      frame "Cancel" {
        Array Index(array=s7) -> (out0[s9]=w134)
        Property Node(instance in=w134, "Result"="Canceled") -> (instance out=w135)
        Replace Array Subset(inArray=s7, index=s9, new=w135) -> w136
        call "Handle Data Remaining in Queue.gviweb"(Input_3=reference to "Graph", Input_2=reference to "Step Status", Input_4=w94, Input_5=s9, Input=s6, Input_6=w136, Input_7=w99) -> (Output=w107, Output_3=w104, Output_4=w105, Output_2=w137)
        call "Report Step Complete.gviweb"(Manager Queue=w13, This Queue Name="UI", Step Name=w97, Input_3=w137) -> (Output_2=w100)
        w101 = default
        w102 = s4
        w103 = s5
        w106 = s8
      }
      frame "Cancel Complete" {
        w100 = w99
        w101 = default
        w102 = s4
        w103 = s5
        w104 = s6
        w105 = s7
        w106 = s8
        w107 = s9
      }
      frame "Error" {
        Variant To Data(error in (no error)=w99, type=no error, variant=w98) -> (data=w138, error out=w100)
        # #CodeRecommended - If you ever change the name of this "Error" message, you'll need to update the name in the Check Loop Error.vi as well.
        $ui <- w138
        w101 = default
        w102 = s4
        w103 = s5
        w104 = s6
        w105 = s7
        w106 = s8
        w107 = s9
      }
      frame "---Copy This Frame---" {
        Merge Errors(w99) -> (error out=w100)
        w101 = default
        w102 = s4
        w103 = s5
        w104 = s6
        w105 = s7
        w106 = s8
        w107 = s9
      }
      frame "Exit" {
        Release Queue(queue=w96) -> (error out=w139)
        Release Queue(queue=w94) -> (error out=w140)
        Merge Errors(w99, w139, w140) -> (error out=w100)
        w101 = TRUE
        w102 = s4
        w103 = s5
        w104 = s6
        w105 = s7
        w106 = s8
        w107 = s9
      }
      frame Default {
        case (w95) {
          frame True {
            Wait(time to wait=500)
            call "Receive IO Data.gviweb"(Test data in=s6, Steps status in=s7, Step Index in=s9, error in=w99, IO Data Queue=w94) -> (Test data out=w104, Steps status out=w105, Step Index out=w107, error out=w100, Test Data for Graph=w141)
            $Graph <- w141
            call "Prep Step Staus for Display.gviweb"(Steps status out=w105) -> (Step Status=w142)
            $"Step Status" <- w142
          }
          frame False {
            w143 = "The invalid message string \"%s\" was received in the Message Handling Loop."
            Format Into String(formatString=w143, w97) -> w144
            call "Build Error Cluster.gvi"(code=1, description=w144, error in=w99) -> (error out=w100)
            w104 = s6
            w105 = s7
            w107 = s9
          }
        }
        w101 = default
        w102 = s4
        w103 = s5
        w106 = s8
      }
    }
    call "Error Handler - Message Handling Loop.gvi"(message queue in=w96, error in=w100) -> (dup error in=w145)
    next s4 = w102
    next s5 = w103
    next s6 = w104
    next s7 = w105
    next s8 = w106
    next s9 = w107
    stop if w101
  }
  s12 = uninitialised  # shift register
  s13 = uninitialised  # shift register
  while {
    call "Dequeue Message.gvi"(message queue in=w15, timeout in milliseconds=0, error in=w12) -> (timed out?=w146, message queue out=w147, message=w148, message data=w149, error out=w150)
    # UI Update Loop
    case (w148) ignore case {  # Message Cases
      frame "SW Init" {
        Property Node(instance in=reference to "io", "Value"=no error, error in=w150) -> (error out=w151)
        w152 = default
        w153 = s12
        w154 = "IO Data.gtype" {all zero or empty}
      }
      frame "Initialize" {
        disable {
          frame Disabled {
            # #Integrate_Hardware
            # Hardware uninitialization goes here
            w155 = w150
          }
          frame Enabled {
            call "globals.gviweb"() -> (Globals=w156)
            Property Node(instance in=w156) -> ("Hardware Initialize Duration (s)"=w157)
            # #debug
            Multiply(w157, 1000) -> w158
            Wait(time to wait=w158)
            w155 = w150
          }
        }
        call "Report Step Complete.gviweb"(Manager Queue=w13, This Queue Name="IO", Step Name=w148, Input_3=w155) -> (Output_2=w151)
        w152 = default
        w153 = s12
        w154 = s13
      }
      frame "Finalize" {
        disable {
          frame Disabled {
            # #Integrate_Hardware
            # Hardware uninitialization goes here
            w159 = w150
          }
          frame Enabled {
            call "globals.gviweb"() -> (Globals=w160)
            Property Node(instance in=w160) -> ("Hardware Finalize Duration (s)"=w161)
            # #debug
            Multiply(w161, 1000) -> w162
            Wait(time to wait=w162)
            w159 = w150
          }
        }
        call "Report Step Complete.gviweb"(Manager Queue=w13, This Queue Name="IO", Step Name=w148, Input_3=w159) -> (Output_2=w151)
        w152 = default
        w153 = s12
        w154 = s13
      }
      frame "Execute" {
        # #todo move some of this functionality to initialization and check if test sequence is empty
        # report empty back to manager
        call "Handle Next Waveform.gviweb"(Test Sequence in=$"Test Sequence", IO Data In=s13) -> (Test Sequence out=w153, IO Data out=w154)
        w151 = w150
        w152 = default
      }
      frame "Cancel" {
        sequence {
          frame 0 {
            # Stop IO
            Property Node(instance in=s13, "Wave Active"=FALSE) -> (instance out=w154)
          }
        }
        call "Report Step Complete.gviweb"(Manager Queue=w13, This Queue Name="IO", Step Name=w148, Input_3=w150) -> (Output_2=w151)
        w152 = default
        w153 = s12
      }
      frame "Error" {
        Variant To Data(error in (no error)=w150, type=no error, variant=w149) -> (data=w163, error out=w151)
        # #CodeRecommended - If you ever change the name of this "Error" message, you'll need to update the name in the Check Loop Error.vi as well.
        $io <- w163
        w152 = default
        w153 = s12
        w154 = s13
      }
      frame "---Copy This Frame---" {
        Merge Errors(w150) -> (error out=w151)
        w152 = default
        w153 = s12
        w154 = s13
      }
      frame "Exit" {
        Release Queue(queue=w147) -> (error out=w164)
        Merge Errors(w150, w164) -> (error out=w151)
        w152 = TRUE
        w153 = s12
        w154 = s13
      }
      frame Default {
        case (w146) {
          frame True {
            Property Node(instance in=s13) -> ("Wave Active"=w165, instance out=w166)
            # No message -> handle output
            case (w165) {
              frame False, Default {
                w154 = w166
                w151 = w150
                w153 = s12
              }
              frame True {
                Property Node(instance in=w166) -> ("New Wave"=w167, instance out=w168)
                case (w167) {
                  frame False, Default {
                    w169 = w168
                  }
                  frame True {
                    Get Current Time() -> (current time=w170)
                    # only save init timestamp at wave start
                    Property Node(instance in=w168, "Start Time"=w170, "New Wave"=FALSE) -> (instance out=w169)
                  }
                }
                call "Generate Waveform.gviweb"(IO Data=w169) -> (Time Elapsed=w171, IO data out=w172, Wave Value=w173, Fraction Complete=w174)
                call "Handle Hardware IO.gviweb"(IO data in=w172, Hardware output=w173, Time Elapsed=w171) -> (IO data out=w175, Hardware input=w176)
                call "Check Test Sequence Complete.gviweb"(This Queue Name="IO", Test Sequence in=s12, IO data in=w175, Fraction Complete=w174, Manager Queue=w13) -> (Test Sequence out=w153, IO data out=w154, Fraction Complete (includes messages)=w177)
                Build Array(w177, w173, w176) -> w178
                Enqueue Element(element=w178, error in=w150, queue=w94) -> (error out=w151)
              }
            }
          }
          frame False {
            # Received message
            w179 = "The invalid message string \"%s\" was received in the Message Handling Loop."
            Format Into String(formatString=w179, w148) -> w180
            call "Build Error Cluster.gvi"(code=1, description=w180, error in=w150) -> (error out=w151)
            w154 = s13
            w153 = s12
          }
        }
        w152 = default
      }
    }
    call "Error Handler - Message Handling Loop.gvi"(message queue in=w147, error in=w151) -> (dup error in=w181)
    Wait(time to wait=50)
    next s12 = w153
    next s13 = w154
    stop if w152
  }
  Property Node(instance in=reference to "Test Sequence", "Value"=[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])
